# Grasshopper definition grid-chooser.gh (Grasshopper 0.9.76)

number_slider = Slider(0.3, range=0..1)
number_slider_2 = Slider(4, range=3..12)
sqgrid = Square(Plane=PlaneXY(0, 0, 0), Size=number_slider, ExtentX=5, ExtentY=5)  # -> Cells, flatten(Points)
trigrid = Triangular(Plane=PlaneXY(0, 0, 0), Size=number_slider, ExtentX=5, ExtentY=5)  # -> Cells, flatten(Points)
filter = CSharpScript(x=sqgrid.Points, y=trigrid.Points, z=number_slider_2)  # -> out, A; inputs z: Int32
# ---------- filter: C# ----------
    if(z == 4){
      A = x;
    }
    if(z == 6){
      A = y;
    }
# ---------- end filter ----------
panel = Panel(filter.A)
polygon = Polygon(Plane=filter.A, Radius=3, Segments=number_slider_2, FilletRadius=0)  # -> Polygon, Length
