# Grasshopper definition hex-spiral.gh (Grasshopper 0.9.76)

number_slider = Slider(1.3, range=0..10)
multiplication = Multiplication(A=number_slider, B=1)
multiplication_2 = Multiplication(A=number_slider, B=1.5)
multiplication_3 = Multiplication(A=number_slider, B=2)
trigrid = Triangular(Plane=PlaneXY(0, 0, 0), Size=Slider(8.1, range=0..10), ExtentX=5, ExtentY=5)  # -> Cells, Points
cp = ControlPoints(Curve=trigrid.Cells)  # -> Points, Weights, Knots
polygon = Polygon(Plane=cp.Points, Radius=multiplication, Segments=6, FilletRadius=0)  # -> Polygon, Length
polygon_2 = Polygon(Plane=cp.Points, Radius=multiplication_2, Segments=6, FilletRadius=0)  # -> Polygon, Length
polygon_3 = Polygon(Plane=cp.Points, Radius=multiplication_3, Segments=6, FilletRadius=0)  # -> Polygon, Length
rotate = Rotate(Geometry=polygon.Polygon, Angle=1.570796327, Plane=cp.Points)  # -> Geometry, Transform
rotate_2 = Rotate(Geometry=polygon_2.Polygon, Angle=3.141592654, Plane=cp.Points)  # -> Geometry, Transform
rotate_3 = Rotate(Geometry=polygon_3.Polygon, Angle=4.71238898, Plane=cp.Points)  # -> Geometry, Transform
cp_2 = ControlPoints(Curve=rotate.Geometry)  # -> Points, Weights, Knots
cp_3 = ControlPoints(Curve=rotate_3.Geometry)  # -> Points, Weights, Knots
cp_4 = ControlPoints(Curve=rotate_2.Geometry)  # -> Points, Weights, Knots
item = ListItem(List=cp_2.Points, Index=0, Wrap=True)
item_2 = ListItem(List=cp_4.Points, Index=0, Wrap=True)
item_3 = ListItem(List=cp_3.Points, Index=0, Wrap=True)
intcrv = Interpolate(Vertices=[item, item_2, item_3], Degree=3, Periodic=False, KnotStyle=1)  # -> Curve, Length, Domain
