# Grasshopper definition pattern.gh (Grasshopper 1.0.4)

number_slider = Slider(38, range=0..100)
number_slider_2 = Slider(2.1, range=0..10)

rectangle = Rectangle(Plane=PlaneXY(0, 0, 0), XSize=number_slider_2, YSize=number_slider_2, Radius=0)  # -> Rectangle, Length
division = Division(A=number_slider_2, B=2)
arrrec = RectangularArray(Geometry=<point referenced from the Rhino model>, Cell=rectangle.Rectangle, XCount=number_slider, YCount=number_slider)  # -> Geometry, Transform
subtraction = Subtraction(A=division, B=Slider(0.1, range=0..10))
image = ImageSampler(
    arrrec.Geometry,
    FilePath="/Users/bbalogh/Desktop/34b77cbd897436a69d28de790ab6fbe2.jpg",
    Filter="Value",
    Interpolate=False,
    Umax=40,
    Umin=0,
    Vmax=40,
    Vmin=0,
    Wrap=1)
dom = ConstructDomain(DomainStart=Slider(0.3, range=0..10), DomainEnd=subtraction)
bnd = Bounds(Numbers=image)
remap = RemapNumbers(Value=image, Source=bnd, Target=dom)  # -> Mapped, Clipped
circle = CircleCNR(Center=arrrec.Geometry, Normal=Vector(0, 0, 1), Radius=remap.Mapped)
