# Grasshopper definition pattern2.gh (Grasshopper 1.0.4)

crv = Curve(<curve referenced from the Rhino model>)
drec = DeconstuctRectangle(Rectangle=crv)  # -> BasePlane, XInterval, YInterval
range = Range(Domain=drec.XInterval, Steps=Slider(50, range=0..100))
range_2 = Range(Domain=drec.YInterval, Steps=Slider(50, range=0..100))
crossref = CrossReference(ListA=range, ListB=range_2, CrossMode=1)  # -> ListA, ListB
item = ListItem(List=range, Index=0, Wrap=True)
item_2 = ListItem(List=range, Index=1, Wrap=True)
pdecon = Deconstruct(Point=drec.BasePlane)  # -> XComponent, YComponent, ZComponent
subtraction = Subtraction(A=item_2, B=item)
addition = Addition(A=crossref.ListA, B=pdecon.XComponent)
addition_2 = Addition(A=crossref.ListB, B=pdecon.YComponent)
division = Division(A=subtraction, B=2)
subtraction_2 = Subtraction(A=division, B=Slider(0.19, range=0..1))
pt = ConstructPoint(XCoordinate=addition, YCoordinate=addition_2, ZCoordinate=0)
dom = ConstructDomain(DomainStart=0, DomainEnd=subtraction_2)
image = ImageSampler(
    pt,
    FilePath="/Users/bbalogh/Desktop/34b77cbd897436a69d28de790ab6fbe2.jpg",
    Filter="Value",
    Interpolate=False,
    Umax=50,
    Umin=1,
    Vmax=50,
    Vmin=1,
    Wrap=1)
bnd = Bounds(Numbers=image)
remap = RemapNumbers(Value=image, Source=bnd, Target=dom)  # -> Mapped, Clipped
circle = CircleCNR(Center=pt, Normal=Vector(0, 0, 1), Radius=remap.Mapped)
