# Grasshopper definition point_Writer.gh (Grasshopper 0.9.76)
# plug-ins: Firefly.Kinect.V1

# ---- group: Record Data
start = BooleanToggle(True)
filter = BooleanToggle(False)
list = ValueList({"HipCenter": 0, "Spine": 1, "ShoulderCenter": 2, "Head": 3, "ShoulderLeft": 4, "ElbowLeft": 5, "WristLeft": 6, "HandLeft": 7, "ShoulderRight": 8, "ElbowRight": 9, "WristRight": 10, "HandRight": 11, "HipLeft": 12, "KneeLeft": 13, "AnkleLeft": 14, "FootLeft": 15, "HipRight": 16, "KneeRight": 17, "AnkleRight": 18, "FootRight": 19}, selected="HipCenter")
path = Panel("C:\Users\Student\Desktop\test4")
record = BooleanToggle(False)
skeleton = KinectV1SkeletalTracker(StartSkeletonTracker=start, SkeletonScaleFactor=1, TranslateInZAxis=0, TimerIntervalInMillisecondsForUpdatingEvents=5)  # -> Points, JointID, Bones
item = ListItem(List=skeleton.Points, Index=list, Wrap=True)
filter_2 = CSharpScript(x=item, y=skeleton.Points, z=filter)  # -> out, A; inputs z: Boolean
# ---------- filter_2: C# ----------
    if(z){
      A = x;
    }
    if(!z){
      A = y;
    }
# ---------- end filter_2 ----------
c_script = CSharpScript(Path=path, DataSet=filter_2.A, Run=record)  # -> out, A; inputs Path: String, DataSet: Point3d, Run: Boolean
# ---------- c_script: C# ----------
    if (Run)
    {
      using (var writer = new CsvFileWriter(Path + ".csv"))
      {
        List<string> tempList = new List<string>();
        for(int i = 0; i < 19; i++)
        {
          tempList.Add(DataSet.ToString());
        }

        if (tempList != null && tempList.Count > 0 && Path != String.Empty)
        {
          writer.WriteRow(tempList);
        }
      }
    }
# ---------- c_script: C# additional code ----------
  /// <summary>
  /// Determines how empty lines are interpreted when reading CSV files.
  /// These values do not affect empty lines that occur within quoted fields
  /// or empty lines that appear at the end of the input file.
  /// </summary>
  public enum EmptyLineBehavior
  {
    /// <summary>
    /// Empty lines are interpreted as a line with zero columns.
    /// </summary>
    NoColumns,
    /// <summary>
    /// Empty lines are interpreted as a line with a single empty column.
    /// </summary>
    EmptyColumn,
    /// <summary>
    /// Empty lines are skipped over as though they did not exist.
    /// </summary>
    Ignore,
    /// <summary>
    /// An empty line is interpreted as the end of the input file.
    /// </summary>
    EndOfFile,
  }

  /// <summary>
  /// Common base class for CSV reader and writer classes.
  /// </summary>
  public abstract class CsvFileCommon
  {
    /// <summary>
    /// These are special characters in CSV files. If a column contains any
    /// of these characters, the entire column is wrapped in double quotes.
    /// </summary>
    protected char[] SpecialChars = new char[] { ',', '"', '\r', '\n' };

    // Indexes into SpecialChars for characters with specific meaning
    private const int DelimiterIndex = 0;
    private const int QuoteIndex = 1;

    /// <summary>
    /// Gets/sets the character used for column delimiters.
    /// </summary>
    public char Delimiter
    {
      get { return SpecialChars[DelimiterIndex]; }
      set { SpecialChars[DelimiterIndex] = value; }
    }

    /// <summary>
    /// Gets/sets the character used for column quotes.
    /// </summary>
    public char Quote
    {
      get { return SpecialChars[QuoteIndex]; }
      set { SpecialChars[QuoteIndex] = value; }
    }
  }

  /// <summary>
  /// Class for writing to comma-separated-value (CSV) files.
  /// </summary>
  public class CsvFileWriter : CsvFileCommon, IDisposable
  {
    // Private members
    private StreamWriter Writer;
    private string OneQuote = null;
    private string TwoQuotes = null;
    private string QuotedFormat = null;

    /// <summary>
    /// Initializes a new instance of the CsvFileWriter class for the
    /// specified stream.
    /// </summary>
    /// <param name="stream">The stream to write to</param>
    public CsvFileWriter(Stream stream)
    {
      Writer = new StreamWriter(stream);
    }

    /// <summary>
    /// Initializes a new instance of the CsvFileWriter class for the
    /// specified file path.
    /// </summary>
    /// <param name="path">The name of the CSV file to write to</param>
    public CsvFileWriter(string path)
    {
      Writer = new StreamWriter(path, true);
    }

    /// <summary>
    /// Writes a row of columns to the current CSV file.
    /// </summary>
    /// <param name="columns">The list of columns to write</param>
    public void WriteRow(List<string> columns)
    {
      // Verify required argument
      if (columns == null)
        throw new ArgumentNullException("columns");

      // Ensure we're using current quote character
      if (OneQuote == null || OneQuote[0] != Quote)
      {
        OneQuote = String.Format("{0}", Quote);
        TwoQuotes = String.Format("{0}{0}", Quote);
        QuotedFormat = String.Format("{0}{{0}}{0}", Quote);
      }

      // Write each column
      for (int i = 0; i < columns.Count; i++)
      {
        // Add delimiter if this isn't the first column
        if (i > 0)
          Writer.Write(Delimiter);
        // Write this column
        if (columns[i].IndexOfAny(SpecialChars) == -1)
          Writer.Write(columns[i]);
        else
          Writer.Write(QuotedFormat, columns[i].Replace(OneQuote, TwoQuotes));
      }
      Writer.WriteLine();
    }

    // Propagate Dispose to StreamWriter
    public void Dispose()
    {
      Writer.Dispose();
    }
  }
# ---------- end c_script ----------
panel = Panel(c_script.A)

# ---- group: Read Data
path_2 = FilePath("C:\Users\Student\Desktop\test4.csv")
file = ReadFile(File=path_2, PerLineParse=True)
txt = Text(graft(file))
split = TextSplit(Text=txt, Separators=",")
rep = ReplaceText(Text=split, Find="\"", RecursiveReplace=False)
partition = PartitionList(List=rep, Size=3)
item_2 = ListItem(List=partition, Index=1, Wrap=True)
item_3 = ListItem(List=partition, Index=2, Wrap=True)
item_4 = ListItem(List=partition, Index=0, Wrap=True)
pt = ConstructPoint(XCoordinate=item_4, YCoordinate=item_2, ZCoordinate=item_3)
